# Dynamo graph Pretratamiento BIM.dyn (Dynamo 1.3.3.4111)

ancho_de_canal_w = DoubleInput(2)
tirante_h = DoubleInput(0.5)
bordo_libre_hb = DoubleInput(0.5)
caudal_q = DoubleInput(2)
ángulo_de_barras_theta = DoubleInput(45)
espacio_entre_barras_c = DoubleInput(0.03)
espesor_de_barras_db = DoubleInput(0.02)
python_script = Python(IN[0]=ancho_de_canal_w, IN[1]=tirante_h, IN[2]=bordo_libre_hb, IN[3]=caudal_q, IN[4]=ángulo_de_barras_theta, IN[5]=espacio_entre_barras_c, IN[6]=espesor_de_barras_db)
# ---------- python_script.python (88 lines) ----------
import clr
import math
clr.AddReference('ProtoGeometry')
from Autodesk.DesignScript.Geometry import *

W = IN[0]
h = IN[1]
hb = IN[2]
Q = IN[3]
theta = IN[4]
C = IN[5]
db = IN[6]

g = 9.81

# PRELIMINARES

theta_rad = math.radians(theta)
Ht = h + hb

# ÁREA DEL CANAL

A = W * h

# VELOCIDAD ANTES DE LAS REJILLAS

if A <= 0:
	V = None
else: 
	V = Q / A

# LONGITUD DE LA BARRA

if math.sin(theta_rad) <= 0:
	L = None
else: 
	L = (h + hb) / math.sin(theta_rad)
	
# NÚMERO DE BARRAS

if (C + db) <= 0:
	n = None
else: 
	n = ((W - C) / (C + db)) - 1

if n is not None: 
	n = int(math.ceil(n))
	
# VELOCIDAD DE ACERCAMIENTO

if (W - db) * h <= 0:
	Va = None
else:
	Va = Q / ((W - db) * h)

# ÁREA DE LAS REJAS

Ar = n * db * h

# VELOCIDAD EN LA REJA

if A - Ar <= 0:
	Vr = None
else:
	Vr = Q / (A - Ar)
	
# PÉRDIDA HIDRÁULICA

if Vr < 0 or Va < 0:
	hL = None
else: 
	hL = (1.0 / 0.7) * ((Vr**2 - Va**2) / (2 * g))
	
if hL is not None and hL < 0:
	hL = 0 
	
# SALIDA EN DICCIONARIO

OUT = {
	A, 
	V, 
	L, 
	n,
	Va, 
	Ar, 
	Vr, 
	hL
}
# ----------------------------------------
